# Requirement set fred_catalog (R2026a)
FRED Metadata Catalog (ADIT2200, Fall 2026). Generated by src/build_fred_requirements.m.

## 1 [CARD] Cardinality: every crow's-foot constraint on the ERD holds in the graph (Container)
Neo4j Community cannot declare cardinality. Each constraint is a query in neo4j/cypher/fred_degree_audit.cypher whose expected answer is zero rows. Rules A01 to A05 tolerate the data-list series (dataset_id set).

### 1.1 [A01] fk_series_release: every Series is in exactly one Release
fk_series_release: every Series is in exactly one Release. Known exception: the 41 data-list series (dataset_id set) came from the FRED data-list archive, not the series API, and carry release as text only. They should be 0 here once the catalog crawl reaches them.

### 1.2 [A02] fk_series_frequency: exactly one Frequency
fk_series_frequency: exactly one Frequency.

### 1.3 [A03] fk_series_units: exactly one Units
fk_series_units: exactly one Units.

### 1.4 [A04] fk_series_sa: exactly one SeasonalAdjustment
fk_series_sa: exactly one SeasonalAdjustment.

### 1.5 [A05] series_category (rule 5): a series is classified in at least one category
series_category (rule 5): a series is classified in at least one category. Zero is the data-list exception again.

### 1.6 [A06] release_source (rule 1): every release is published by at least one source
release_source (rule 1): every release is published by at least one source. Mandatory on the release side in the ERD.

### 1.7 [A07] fk_release_date_release (weak entity, rule 2): a ReleaseDate belongs to exactly one Release
fk_release_date_release (weak entity, rule 2): a ReleaseDate belongs to exactly one Release. The FK direction is reversed in the graph (Release-[:SCHEDULED_ON]->ReleaseDate), so count incoming edges.

### 1.8 [A08] fk_category_parent (unary 1:M): at most one parent, and zero only for the root (is_root = true)
fk_category_parent (unary 1:M): at most one parent, and zero only for the root (is_root = true).

### 1.9 [A09] fk_tag_tag_group (rule 8): exactly one TagGroup
fk_tag_tag_group (rule 8): exactly one TagGroup.

### 1.10 [A10] Document layer (graph only): a Document describes exactly one Release, and a Chunk belongs to exactly one Document
Document layer (graph only): a Document describes exactly one Release, and a Chunk belongs to exactly one Document.

### 1.11 [A11] Chunk<-HAS_CHUNK
See the statement labelled A11 in the audit file.

### 1.12 [A12] Lineage (graph only): a SeriesVariant belongs to exactly one Series and is available in exactly one SourceMember
Lineage (graph only): a SeriesVariant belongs to exactly one Series and is available in exactly one SourceMember.

### 1.13 [A13] Dangling business keys: the FK value kept as a property must agree with the edge (the graph stores both; they can drift)
Dangling business keys: the FK value kept as a property must agree with the edge (the graph stores both; they can drift).

### 1.14 [A14] Chunk.doc_id drift
See the statement labelled A14 in the audit file.

### 1.15 [A15] fk_rte_release (rule 12): a ReleaseTableElement is listed in exactly one Release
fk_rte_release (rule 12): a ReleaseTableElement is listed in exactly one Release.

### 1.16 [A16] fk_rte_parent (unary 1:M, rule 12): an element has one parent, except a top-level section (parent_key absent), which has none
fk_rte_parent (unary 1:M, rule 12): an element has one parent, except a top-level section (parent_key absent), which has none.

### 1.17 [A17] SHOWS (graph only, no FK in SQL): a series row shows at most one Series, and only a series row shows one
SHOWS (graph only, no FK in SQL): a series row shows at most one Series, and only a series row shows one. Zero on a series row is allowed: the catalog holds a subset of each release's series.

## 2 [MODEL] One checked model: diagrams, DDL and live stores never disagree (Container)
src/+dbdesign/fred_relational_model.m is the single source; every other representation is compared with it.

### 2.1 [M01] The model matches sql/fred_schema.sql (PostgreSQL)
Tables, column order, declared types, NOT NULL, defaults, keys, foreign keys with ON DELETE, CHECK constraints and indexes.

### 2.2 [M02] The model matches sql/mysql/fred_schema.sql (MySQL/MariaDB)
Same comparison for the MySQL dialect.

### 2.3 [M03] The graph model covers the relational model
Every table is a label, a join table turned relationship, or listed as excluded; every foreign key is a relationship or excluded.

### 2.4 [M04] The live PostgreSQL catalog matches the model
information_schema and pg_catalog agree with the model, including triggers, functions and procedures.

### 2.5 [M05] The live Neo4j database matches the graph model
Labels, property types, relationship patterns, uniqueness constraints and indexes agree with dbdesign.fred_graph_model.

### 2.6 [M06] Every diagram names every table, label and relationship it documents
The logical, FD-map, table-map, physical and graph views are rendered from the model and compile with Graphviz.

### 2.7 [M07] The degree audit names only relationship types the graph model declares
Seventeen statements A01..A17 in order, each returning a rule column.

## 3 [GDSS] Forecast adapters honour the fit-payload contract (Container)

### 3.1 [G01] The naive random-walk fit payload carries all six uncertainty fields
parameter_covariance, parameter_standard_error, each with _status and _reference. Regression for commit ab38d13, which spliced two assignments into one line.